# Grasshopper definition Geometries.ghx (Grasshopper 1.0.7)
# plug-ins: LunchBox

number_slider = Slider(150, range=0..1000)
number_slider_2 = Slider(3, range=0..10)
number_slider_3 = Slider(3, range=0..10)
rectangle = Rectangle(Plane=PlaneXY(0, 0, 0), XSize=number_slider, YSize=Slider(600, range=0..1000), Radius=0)  # -> Rectangle, Length
squads = SkewedQuads(Surface=rectangle.Rectangle, UDivisions=Slider(1, range=0..10), VDivisions=Slider(2, range=0..10), TParameter=0)  # -> FullPanels, EdgePanels
X = UnitX(Factor=expr("x*2", number_slider))
merge = Merge(Data1=squads.FullPanels, Data2=squads.EdgePanels)
mirror = Mirror(Geometry=merge, Plane=PlaneYZ(0, 0, 0))  # -> Geometry, Transform
merge_2 = Merge(Data1=merge, Data2=mirror.Geometry)
number_slider_4 = Slider(10, range=0..10)
layer_height = Slider(2, range=0..10)
layer_number = Slider(2, range=0..10)
panel = Panel("""3
3
3
-3
-3
-3""")
offset = OffsetCurve(Curve=merge_2, Distance=expr("-x", panel), Plane=PlaneXY(0, 0, 0), Corners=1)
arrlinear = LinearArray(Geometry=offset, Direction=X, Count=Slider(2, range=0..10))  # -> flatten(Geometry), Transform
area = Area(Geometry=arrlinear.Geometry)  # -> Area, Centroid
pdecon = Deconstruct(Point=area.Centroid)  # -> XComponent, YComponent, ZComponent
panel_2 = Panel(arrlinear.Geometry)
sort = SortList(Keys=pdecon.XComponent, ValuesA=arrlinear.Geometry)  # -> Keys, ValuesA
geo = Geometry(sort.ValuesA)
cluster = Cluster(B=geo, A=layer_height, B_2=layer_number)

# ----
# Export obj. to data
panel_3 = Panel("20210706_folding.obj")
mjoin = MeshJoin(Meshes=cluster)
export_obj = GhPythonScript(export=Button(), mesh=mjoin, ObjName=panel_3)  # -> out, a; inputs mesh: Mesh
# ---------- export_obj: Python ----------
import os
import sys
import compas_rhino
from compas_rhino.geometry import RhinoMesh
import Rhino.Geometry as rg 


filepath = ghenv.Component.Attributes.Owner.OnPingDocument().FilePath
path = os.path.abspath(os.path.join(filepath, "..","data","3D_for_4D.obj"))
path_storage = os.path.abspath(os.path.join(filepath, "..", "..","obj",ObjName))

print (path_storage)
HERE = os.path.join(os.path.abspath(path)) 
HERE_storage = os.path.join(os.path.abspath(path_storage))

#######


if export:
    print(HERE)
    print(HERE_storage)
    c_mesh = RhinoMesh.from_geometry(mesh).to_compas()
    c_mesh.to_obj(HERE, None, True)
    c_mesh.to_obj(HERE_storage, None, True)
# ---------- end export_obj ----------

number_slider_5 = Slider(600, range=0..1000)
number_slider_6 = Slider(2, range=0..10)
rectangle_2 = Rectangle(Plane=PlaneXY(0, 0, 0), XSize=number_slider_5, YSize=number_slider_5, Radius=0)  # -> Rectangle, Length
number_slider_7 = Slider(2, range=0..10)
diamond = DiamondPanels(Surface=rectangle_2.Rectangle, UDivisions=Slider(5, range=0..10), VDivisions=Slider(8, range=0..10))  # -> DiamondPanels, TriPanels
neg = Negative(Value=number_slider_6)
fillet = Fillet(Curve=diamond.DiamondPanels, Radius=number_slider_7)
fillet_2 = Fillet(Curve=diamond.TriPanels, Radius=number_slider_7)
merge_3 = Merge(Data1=fillet, Data2=fillet_2)

quads = QuadPanels(Surface=rectangle_2.Rectangle, UDivisions=number_slider_3, VDivisions=number_slider_3)
tric = TrianglePanelsC(Surface=rectangle_2.Rectangle, UDivisions=number_slider_2, VDivisions=number_slider_2)
offset_2 = OffsetCurve(Curve=rectangle_2.Rectangle, Distance=number_slider_6, Plane=PlaneXY(0, 0, 0), Corners=1)
offset_3 = OffsetCurve(Curve=tric, Distance=neg, Plane=PlaneXY(0, 0, 0), Corners=1)

offset_4 = OffsetCurve(Curve=quads, Distance=neg, Plane=PlaneXY(0, 0, 0), Corners=1)

fillet_3 = Fillet(Curve=offset_3, Radius=Slider(3, range=0..10))
merge_4 = Merge(Data1=offset_4, Data2=offset_2)  # -> flatten(Result)

# ==== cluster Cluster
B = ClusterInput()
A = ClusterInput()
B_2 = ClusterInput()
multiplication = Multiplication(A=A, B=B_2)
Z = UnitZ(Factor=expr("x-0.05", multiplication))
extr = Extrude(Base=B, Direction=Z)
mjoin = MeshJoin(Meshes=extr)
tri = Triangulate(Mesh=mjoin)  # -> Mesh, Count
M = ClusterOutput(tri.Mesh)
